# Grasshopper definition sensitivityGH_exemple.gh (Grasshopper 1.0.7)
# plug-ins: ClimateStudioGH

width = Slider(24, range=0..100)
length = Slider(20, range=0..100)

corner_1 = Slider(9.2, range=5..10)
corner_2 = Slider(9.7, range=5..10)
corner_3 = Slider(6.4, range=5..10)
corner_4 = Slider(6.2, range=5..10)

win_height = Slider(5, range=0..10)
wall_height = Slider(3, range=0..10)

path = FilePath("C:\Users\liors\anaconda3\envs\ghNew\python.exe")
path_2 = FilePath("C:\Users\liors\Desktop\test sens\Code\sensitivityGenerator.py")
cluster = Cluster(X=width, Y=length, A=[corner_1, corner_2, corner_3, corner_4], F=win_height, F_2=wall_height)  # -> floor, window, wall, roof, roof_2
geo = Geometry(cluster.floor)
geo_2 = Geometry(cluster.window)
geo_3 = Geometry(cluster.wall)
geo_4 = Geometry(cluster.roof)
geo_5 = Geometry(cluster.roof_2)
material = GetCSLightingMaterial(Search="floor lm83", UnitSystem=4)
material_2 = GetCSLightingMaterial(Search="wall lm83", UnitSystem=4)
material_3 = GetCSLightingMaterial(Search="ceiling lm83", UnitSystem=4)
panel = Panel("""1
2
3
4""")
panel_2 = Panel("""Multipurpose
Multipurpose
Multipurpose
Multipurpose""")
glazing = GetCSGlazingAssembly(UnitSystem=4)
shade = GetCSWovenShade(UnitSystem=4)
# Surfaces added to the Window component
# should not also be added to SceneLayers.
grid = ConstructCSSensorGrid(
    Level="LEVEL 01",
    Id=panel,
    Description=panel_2,
    Geometry=geo,
    Spacing="2.5",
    Input_0_Hidden=True,
    Input_0_Name="Building",
    Input_10_Hidden=True,
    Input_10_Name="SupplementalLux",
    Input_11_Hidden=True,
    Input_11_Name="TargetLux",
    Input_12_Hidden=True,
    Input_12_Name="ExcessiveLux",
    Input_13_Hidden=True,
    Input_13_Name="sDA_Time",
    Input_14_Hidden=True,
    Input_14_Name="BREEAMSpaceType",
    Input_15_Hidden=True,
    Input_15_Name="ViewOffset",
    Input_16_Hidden=True,
    Input_16_Name="ViewDirections",
    Input_17_Hidden=True,
    Input_17_Name="ViewRotation",
    Input_18_Hidden=True,
    Input_18_Name="Points Override",
    Input_19_Hidden=True,
    Input_19_Name="Normals Override",
    Input_1_Hidden=False,
    Input_1_Name="Level",
    Input_20_Hidden=True,
    Input_20_Name="Disk Radius",
    Input_2_Hidden=False,
    Input_2_Name="Id",
    Input_3_Hidden=False,
    Input_3_Name="Description"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)
window = ConstructCSWindow(
    Glazing=glazing,
    WovenShade=shade,
    Surface=geo_2,
    Input_0_Hidden=False,
    Input_0_Name="Glazing",
    Input_1_Hidden=False,
    Input_1_Name="WovenShade",
    Input_2_Hidden=False,
    Input_2_Name="Position",
    Input_3_Hidden=True,
    Input_3_Name="Rotation",
    Input_4_Hidden=False,
    Input_4_Name="Position Schedule",
    Input_5_Hidden=True,
    Input_5_Name="Rotation Schedule",
    Input_6_Hidden=True,
    Input_6_Name="ECGlass",
    Input_7_Hidden=True,
    Input_7_Name="Tint",
    Input_8_Hidden=True,
    Input_8_Name="Tint Schedule",
    Input_9_Hidden=False,
    Input_9_Name="Surface",
    UnitSystem=4)
scenelayer = ConstructCSSceneLayer(
    Name="FLOOR",
    Material=material,
    Geometry=geo,
    Input_0_Hidden=False,
    Input_0_Name="Name",
    Input_1_Hidden=False,
    Input_1_Name="Material",
    Input_2_Hidden=False,
    Input_2_Name="Geometry",
    UnitSystem=4)
scenelayer_2 = ConstructCSSceneLayer(
    Name="WALL",
    Material=material_2,
    Geometry=geo_3,
    Input_0_Hidden=False,
    Input_0_Name="Name",
    Input_1_Hidden=False,
    Input_1_Name="Material",
    Input_2_Hidden=False,
    Input_2_Name="Geometry",
    UnitSystem=4)
scenelayer_3 = ConstructCSSceneLayer(
    Name="CEILING",
    Material=material_3,
    Geometry=geo_4,
    Input_0_Hidden=False,
    Input_0_Name="Name",
    Input_1_Hidden=False,
    Input_1_Name="Material",
    Input_2_Hidden=False,
    Input_2_Name="Geometry",
    UnitSystem=4)
data = Data(flatten([scenelayer_3, scenelayer, scenelayer_2]))

toggle = BooleanToggle(False)
daylightmodel = ConstructCSDaylightModel(
    SceneLayers=data,
    Windows=window,
    SensorGrids=grid,
    NorthOffset=0,
    Input_0_Hidden=False,
    Input_0_Name="SceneLayers",
    Input_1_Hidden=False,
    Input_1_Name="Windows",
    Input_2_Hidden=False,
    Input_2_Name="Luminiares",
    Input_3_Hidden=False,
    Input_3_Name="SensorGrids",
    Input_4_Hidden=False,
    Input_4_Name="Camera",
    Input_5_Hidden=False,
    Input_5_Name="North Offset",
    UnitSystem=4)
daylight = RunCSDaylight(
    Name="Example_ICD\Custom_Daylight_MOO",
    Model=daylightmodel,
    WeatherFile="USA_MA_Boston-Logan.Intl.AP.725090_TMY3",
    Samples=4096,
    SaveHourly=False,
    Run=toggle,
    Input_0_Hidden=False,
    Input_0_Name="Name",
    Input_1_Hidden=False,
    Input_1_Name="Model",
    Input_2_Hidden=True,
    Input_2_Name="BldgType",
    Input_3_Hidden=False,
    Input_3_Name="WeatherFile",
    Input_4_Hidden=True,
    Input_4_Name="Ground Albedo",
    Input_5_Hidden=False,
    Input_5_Name="Samples",
    Input_6_Hidden=False,
    Input_6_Name="Save Hourly",
    Input_7_Hidden=True,
    Input_7_Name="Threads",
    Input_8_Hidden=True,
    Input_8_Name="Hide Pop-up",
    Input_9_Hidden=False,
    Input_9_Name="Run",
    Standard=0,
    UnitSystem=4,
    Input_2_GHParam_Branch0_Path="{0}",
    Input_2_GHParam_Branch0_Item0_null_string=False,
    Input_2_GHParam_Branch0_Item0_string="Office",
    Input_4_GHParam_Branch0_Path="{0}",
    Input_4_GHParam_Branch0_Item0_number=0.2,
    Input_7_GHParam_Branch0_Path="{0}",
    Input_7_GHParam_Branch0_Item0_number=0,
    Input_8_GHParam_Branch0_Path="{0}",
    Input_8_GHParam_Branch0_Item0_boolean=False)
csr = LoadCSResult(
    Result=daylight,
    Header=False,
    Output_0_Hidden=False,
    Output_0_Name="Name",
    Output_10_Hidden=True,
    Output_10_Name="Weather",
    Output_11_Hidden=True,
    Output_11_Name="North",
    Output_12_Hidden=True,
    Output_12_Name="LayerNames",
    Output_13_Hidden=True,
    Output_13_Name="LayerObjects",
    Output_14_Hidden=True,
    Output_14_Name="LayerMaterials",
    Output_15_Hidden=True,
    Output_15_Name="Sky",
    Output_1_Hidden=False,
    Output_1_Name="Type",
    Output_2_Hidden=True,
    Output_2_Name="Standard",
    Output_3_Hidden=True,
    Output_3_Name="Date",
    Output_4_Hidden=True,
    Output_4_Name="Version",
    Output_5_Hidden=True,
    Output_5_Name="FileSize",
    Output_6_Hidden=True,
    Output_6_Name="RunLog",
    Output_7_Hidden=False,
    Output_7_Name="Metrics",
    Output_8_Hidden=False,
    Output_8_Name="MetricValues",
    Output_9_Hidden=False,
    Output_9_Name="Grids",
    UnitSystem=4)  # -> Name, Type, Metrics, MetricValues, Grids
item = ListItem(List=csr.MetricValues, Index="3", Wrap=True)
item_2 = ListItem(List=csr.MetricValues, Index="2", Wrap=True)
lng = ListLength(List=csr.Metrics)
num = Number(item_2)
previewgrid = PreviewCSSensorGrid(
    Grid=csr.Grids,
    Metric="Mean Illuminance (SensorArray) [lux]",
    Input_0_Hidden=False,
    Input_0_Name="Grid",
    Input_1_Hidden=False,
    Input_1_Name="Metric",
    Input_2_Hidden=True,
    Input_2_Name="Falsecolor",
    Input_3_Hidden=True,
    Input_3_Name="Sensor Values",
    Input_4_Hidden=True,
    Input_4_Name="Show Points",
    Input_5_Hidden=True,
    Input_5_Name="Show Edges",
    Input_6_Hidden=True,
    Input_6_Name="Show Labels",
    Input_7_Hidden=True,
    Input_7_Name="Label Format",
    Input_8_Hidden=True,
    Input_8_Name="Transform",
    UnitSystem=4,
    Input_4_GHParam_Branch0_Path="{0}",
    Input_4_GHParam_Branch0_Item0_boolean=True,
    Input_5_GHParam_Branch0_Path="{0}",
    Input_5_GHParam_Branch0_Item0_boolean=True,
    Input_6_GHParam_Branch0_Path="{0}",
    Input_6_GHParam_Branch0_Item0_boolean=False)
dup = DuplicateData(Data="************************", Number=lng, Order=True)
item_3 = ListItem(List=csr.MetricValues, Index="3", Wrap=True)
weave = Weave(Pattern=[0, 1, 2], Stream0=dup, Stream1=csr.Metrics, Stream2=csr.MetricValues, NullGaps=False)

glare = RunCSAnnualGlare(
    Name="Example_ICD\Annual_Glare_MOO",
    Model=daylightmodel,
    WeatherFile="USA_MA_Boston-Logan.Intl.AP.725090_TMY3",
    Samples=4096,
    SaveHourly=False,
    Run=toggle,
    Input_0_Hidden=False,
    Input_0_Name="Name",
    Input_1_Hidden=False,
    Input_1_Name="Model",
    Input_2_Hidden=False,
    Input_2_Name="WeatherFile",
    Input_3_Hidden=False,
    Input_3_Name="Samples",
    Input_4_Hidden=False,
    Input_4_Name="Save Hourly",
    Input_5_Hidden=True,
    Input_5_Name="Threads",
    Input_6_Hidden=True,
    Input_6_Name="Hide Pop-up",
    Input_7_Hidden=False,
    Input_7_Name="Run",
    UnitSystem=4,
    Input_5_GHParam_Branch0_Path="{0}",
    Input_5_GHParam_Branch0_Item0_number=0)
csr_2 = LoadCSResult(
    Result=glare,
    Header=False,
    Output_0_Hidden=False,
    Output_0_Name="Name",
    Output_10_Hidden=True,
    Output_10_Name="Weather",
    Output_11_Hidden=True,
    Output_11_Name="North",
    Output_12_Hidden=True,
    Output_12_Name="LayerNames",
    Output_13_Hidden=True,
    Output_13_Name="LayerObjects",
    Output_14_Hidden=True,
    Output_14_Name="LayerMaterials",
    Output_15_Hidden=True,
    Output_15_Name="Sky",
    Output_1_Hidden=False,
    Output_1_Name="Type",
    Output_2_Hidden=True,
    Output_2_Name="Standard",
    Output_3_Hidden=True,
    Output_3_Name="Date",
    Output_4_Hidden=True,
    Output_4_Name="Version",
    Output_5_Hidden=True,
    Output_5_Name="FileSize",
    Output_6_Hidden=True,
    Output_6_Name="RunLog",
    Output_7_Hidden=False,
    Output_7_Name="Metrics",
    Output_8_Hidden=False,
    Output_8_Name="MetricValues",
    Output_9_Hidden=False,
    Output_9_Name="Grids",
    UnitSystem=4)  # -> Name, Type, Metrics, MetricValues, Grids
lng_2 = ListLength(List=csr_2.Metrics)
previewgrid_2 = PreviewCSSensorGrid(
    Grid=csr_2.Grids,
    Metric="Perceptible glare [fraction of time DGP > 0.34]",
    Input_0_Hidden=False,
    Input_0_Name="Grid",
    Input_1_Hidden=False,
    Input_1_Name="Metric",
    Input_2_Hidden=True,
    Input_2_Name="Falsecolor",
    Input_3_Hidden=True,
    Input_3_Name="Sensor Values",
    Input_4_Hidden=True,
    Input_4_Name="Show Points",
    Input_5_Hidden=True,
    Input_5_Name="Show Edges",
    Input_6_Hidden=True,
    Input_6_Name="Show Labels",
    Input_7_Hidden=True,
    Input_7_Name="Label Format",
    Input_8_Hidden=True,
    Input_8_Name="Transform",
    UnitSystem=4,
    Input_4_GHParam_Branch0_Path="{0}",
    Input_4_GHParam_Branch0_Item0_boolean=True,
    Input_5_GHParam_Branch0_Path="{0}",
    Input_5_GHParam_Branch0_Item0_boolean=True,
    Input_6_GHParam_Branch0_Path="{0}",
    Input_6_GHParam_Branch0_Item0_boolean=False)
dup_2 = DuplicateData(Data="************************", Number=lng_2, Order=True)
weave_2 = Weave(Pattern=[0, 1, 2], Stream0=dup_2, Stream1=csr_2.Metrics, Stream2=csr_2.MetricValues, NullGaps=False)
metrics = Panel(weave_2)

spatial_discomfort_glare = Number(csr_2.MetricValues)
mean_illuminance = Number(item_3)

merge = Merge(Data1=mean_illuminance, Data2=spatial_discomfort_glare)

date = Panel("210513")
path_3 = Panel("C:\Users\liors\Desktop\test sens\")
solver = Panel("SensetivityAnalysis")
file = Panel("MOO")
join = TextJoin(Text=[date, file, solver], Join="_")
join_2 = TextJoin(Text=[path_3, join])
file_path = Panel(join_2)
merge_2 = Merge(Data1=corner_1, Data2=corner_2, Data3=corner_3, Data4=corner_4)
logger_c = CSharpScript(Path=join_2, Parameters=merge_2, Objectives=merge, Run=toggle)  # -> out, A; inputs Path: String, Parameters: tree of Double, Objectives: tree of Double, Run: Boolean
# ---------- logger_c: C# usings ----------
using System.IO;
using System.Linq;
using System.Data;
using System.Drawing;
using System.Reflection;
using System.Windows.Forms;
using System.Xml;
using System.Xml.Linq;
using System.Runtime.InteropServices;

using Rhino.DocObjects;
using Rhino.Collections;
using GH_IO;
using GH_IO.Serialization;
# ---------- logger_c: C# ----------
    var seperator = ",";

    //Prepare parameter string
    var paramArray = Parameters.AllData().ToArray();
    var strParameters = string.Join(seperator, paramArray);

    //Prepare objective string
    var objArray = Objectives.AllData().ToArray();
    var strObjectives = string.Join(seperator, objArray);

    if (Run)
    {
      using (StreamWriter log = new StreamWriter(Path + ".txt", true))
      {
        log.WriteLine(this.GrasshopperDocument.DisplayName + DateTime.Now.ToString(" hh:mm:ss") + " Parameters " + strParameters + " Objectives " + strObjectives);
      }
    }
# ---------- end logger_c ----------

python = GhPythonScript(
    generateSamples=Button(),
    sliders=[corner_1, corner_2, corner_3, corner_4],
    n_sample=Slider(50, range=0..60),
    pythonEXE=path,
    Script=path_2,
    RUN=Toggle(False),
    path=join_2)  # -> out, CurrentState; inputs sliders: list, n_sample: Int32, RUN: Boolean
# ---------- python: Python ----------
__author__ = "liors"
__version__ = "2021.06.26"

import rhinoscriptsyntax as rs
from Grasshopper.Kernel.Data import GH_Path
import subprocess
import sys
import re


def run(py_exe, py_process,d_p):
    temp = sys.argv[:]
    thread = subprocess.Popen([py_exe,py_process,d_p], stderr=subprocess.PIPE,stdout=subprocess.PIPE,shell=True)
    stderr = thread.communicate()
    stdout = thread.communicate()
    #print (stdout)
    sys.argv = temp
    return (stderr)


if generateSamples:
    params = ""
    count = ghenv.Component.Params.Input[1].Sources.Count
    for i in range(count):
        slider = ghenv.Component.Params.Input[1].Sources[i]
        min,max = slider.Slider.Minimum ,slider.Slider.Maximum
        name = slider.NickName
        params += str(name)+","+str(min)+","+str(max)+";"
    params += str(n_sample)
    runParams = run(pythonEXE,Script,str(params))[0]
    slidersParam = [float(x) for x in re.findall(r"[-+]?\d*\.\d+|\d+",runParams)]
    slidersParam = [slidersParam[x:x+count] for x in range(0,len(slidersParam),count)]
    
    sCount = 0
    
    filePath = path + "Att.txt"
    with open(filePath, 'w') as f:
        f.write(params)
    
    currentValues = []
    print (len(slidersParam))


if RUN:
    currentValues = []
    if sCount<n_sample*(2*count+2):
        
        params = slidersParam[sCount]
        
        for i in range(count):
            
            slider = ghenv.Component.Params.Input[1].Sources[i]
            
            newValue = (((params[i] - 0) * (slider.Slider.Maximum - slider.Slider.Minimum)) / (1 - 0)) + slider.Slider.Minimum
            currentValues.append(newValue)
            
            slider.Slider.Value = newValue
            slider.ExpireSolution(True)
    
    sCount+=1
    ghenv.Component.ExpireSolution(True)
    
print "Sample Number - " + str(sCount) + "/" +str(n_sample*(2*count+2))
if currentValues!=[]:
    CurrentState = currentValues
elif sCount>n_sample*(2*count+2):
    CurrentState = "Done"
else:
    CurrentState = "Ready to go"
# ---------- end python ----------
panel_3 = Panel(python.CurrentState)
panel_4 = Panel(python.out)
metrics_2 = Panel(weave)

# ==== cluster Cluster
X = ClusterInput()
Y = ClusterInput()
A = ClusterInput()
F = ClusterInput()
F_2 = ClusterInput()
rectangle = Rectangle(Plane=PlaneXY(0, 0, 0), XSize=X, YSize=Y, Radius=0)  # -> Rectangle, Length

# ---- group: BASE PLAN
explode = Explode(Curve=rectangle.Rectangle, Recursive=True)  # -> simplify(graft(Segments)), Vertices
pcen = PolygonCenter(Polyline=rectangle.Rectangle)  # -> CenterV, CenterE, CenterA
cull_i = CullIndex(List=explode.Vertices, Indices=-1, Wrap=True)
vec2pt = Vector2Pt(PointA=cull_i, PointB=pcen.CenterV, Unitize=True)  # -> Vector, Length
amp = Amplitude(Vector=vec2pt.Vector, Amplitude=A)
move = Move(Geometry=cull_i, Motion=amp)  # -> Geometry, Transform
pline = PolyLine(Vertices=move.Geometry, Closed=True)
explode_2 = Explode(Curve=pline, Recursive=True)  # -> simplify(graft(Segments)), Vertices

# ----
relay = Relay([explode_2.Segments, explode.Segments])

# ---- group: FLOOR
loft = Loft(Curves=relay, Options={Adjust=False, Closed=False, LoftEnds=0, LoftSimp=0, LoftType=0, Rebuild=10, Refit=0.01})  # -> flatten(Loft)

# ---- group: WINDOW
Z = UnitZ(Factor=F)
extr = Extrude(Base=pline, Direction=Z)
debrep = DeconstructBrep(Brep=extr)  # -> Faces, Edges, Vertices

# ---- group: WALL
Z_2 = UnitZ(Factor=F_2)
extr_2 = Extrude(Base=rectangle.Rectangle, Direction=Z_2)

# ---- group: CEILING
move_2 = Move(Geometry=pline, Motion=Z)  # -> Geometry, Transform
move_3 = Move(Geometry=rectangle.Rectangle, Motion=Z_2)  # -> Geometry, Transform
loft_2 = Loft(
    Curves=flatten([move_2.Geometry, move_3.Geometry]),
    Options={Adjust=False, Closed=False, LoftEnds=0, LoftSimp=0, LoftType=0, Rebuild=10, Refit=0.01})

# ----
geo = Geometry(loft)
geo_2 = Geometry(debrep.Faces)
geo_3 = Geometry(extr_2)
geo_4 = Geometry(loft_2)
floor = ClusterOutput(geo)
window = ClusterOutput(geo_2)
wall = ClusterOutput(geo_3)
roof = ClusterOutput(geo_4)

# ---- group: MASSING
merge = Merge(Data1=geo, Data2=geo_2, Data3=geo_3, Data4=geo_4)  # -> flatten(Result)
join = BrepJoin(Breps=merge)  # -> Breps, Closed

# ----
geo_5 = Geometry(join.Breps)
roof_2 = ClusterOutput(geo_5)
