# Grasshopper definition sensitivityGH.gh (Grasshopper 1.0.7)

path = FilePath("C:\Users\liors\Desktop\test sens\Code\sensitivityGenerator.py")
path_2 = FilePath("C:\Users\liors\anaconda3\envs\ghNew\python.exe")
python = GhPythonScript(generateSamples=Button(), n_sample=Slider(50, range=0..60), pythonEXE=path_2, Script=path, RUN=Toggle(False))  # -> out, CurrentState; inputs sliders: list, n_sample: Int32, RUN: Boolean
# ---------- python: Python ----------
__author__ = "liors"
__version__ = "2021.06.26"

import rhinoscriptsyntax as rs
from Grasshopper.Kernel.Data import GH_Path
import subprocess
import sys
import re


def run(py_exe, py_process,d_p):
    temp = sys.argv[:]
    thread = subprocess.Popen([py_exe,py_process,d_p], stderr=subprocess.PIPE,stdout=subprocess.PIPE,shell=True)
    stderr = thread.communicate()
    stdout = thread.communicate()
    #print (stdout)
    sys.argv = temp
    return (stderr)


if generateSamples:
    params = ""
    count = ghenv.Component.Params.Input[1].Sources.Count
    for i in range(count):
        slider = ghenv.Component.Params.Input[1].Sources[i]
        min,max = slider.Slider.Minimum ,slider.Slider.Maximum
        name = slider.NickName
        params += str(name)+","+str(min)+","+str(max)+";"
    params += str(n_sample)
    runParams = run(pythonEXE,Script,str(params))[0]
    slidersParam = [float(x) for x in re.findall(r"[-+]?\d*\.\d+|\d+",runParams)]
    slidersParam = [slidersParam[x:x+count] for x in range(0,len(slidersParam),count)]
    
    sCount = 0
    
    filePath = path + "Att.txt"
    with open(filePath, 'w') as f:
        f.write(params)
    
    currentValues = []
    print (len(slidersParam))


if RUN:
    currentValues = []
    if sCount<n_sample*(2*count+2):
        
        params = slidersParam[sCount]
        
        for i in range(count):
            
            slider = ghenv.Component.Params.Input[1].Sources[i]
            
            newValue = (((params[i] - 0) * (slider.Slider.Maximum - slider.Slider.Minimum)) / (1 - 0)) + slider.Slider.Minimum
            currentValues.append(newValue)
            
            slider.Slider.Value = newValue
            slider.ExpireSolution(True)
    
    sCount+=1
    ghenv.Component.ExpireSolution(True)
    
print "Sample Number - " + str(sCount) + "/" +str(n_sample*(2*count+2))
if currentValues!=[]:
    CurrentState = currentValues
elif sCount>n_sample*(2*count+2):
    CurrentState = "Done"
else:
    CurrentState = "Ready to go"
# ---------- end python ----------
panel = Panel(python.CurrentState)
panel_2 = Panel(python.out)
